% Simulink data dictionary commonData.sldd

DEFAULT_DEVICE_ID = Simulink.Parameter(struct(device_id=uint8(repmat(0, 10, 1))), DataType="Bus: DeviceIDBusType")
DEFAULT_CONTROLLER_FAULT_LOG_ENTRY = Simulink.Parameter(struct(device_id=struct(device_id=uint8(repmat(0, 10, 1))), fault_code=FaultCodeEnumType.NO_FAULT_CODE_EN), DataType="Bus: ControllerFaultLogEntryBusType")
PER_STEP_MAXIMUM_MESSAGES_TO_PROCESS = Simulink.Parameter(20, DataType="uint8")

DeviceIDBusType = Simulink.Bus(DataScope="Exported")
  device_id: uint8[10 1]

MeasurementMsgBusType = Simulink.Bus(DataScope="Exported")
  source: Bus: DeviceIDBusType
  tire_pressure_sensor_measurement: double

CommonConfigurationSet = Simulink.ConfigSet(StartTime="0", StopTime="50", Solver="FixedStepDiscrete", ProdHWDeviceType="Intel->x86-64 (Windows64)", SystemTargetFile="ert.tlc", TargetLang="C")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