% Simulink data dictionary controllerCoreAlgorithmData.sldd
% references commonData.sldd

ControllerFaultLogEntryBusType = Simulink.Bus()
  device_id: Bus: DeviceIDBusType
  fault_code: Enum: FaultCodeEnumType

controller_fault_log = Simulink.Signal(StorageClass="ExportedGlobal", DataType="Bus: ControllerFaultLogEntryBusType", Dimensions=[10 1])
DEFAULT_MEASUREMENT_MSG_BUS_TYPE = Simulink.Parameter(struct(source=struct(device_id=uint8(repmat(0, 10, 1))), tire_pressure_sensor_measurement=0))
ControllerCodeGenerationConfigurationSet = Simulink.ConfigSet(StartTime="0", StopTime="50", Solver="FixedStepDiscrete", ProdHWDeviceType="Intel->x86-64 (Windows64)", SystemTargetFile="ert.tlc", TargetLang="C")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