% Simulink data dictionary controllerTargetSpecificData.sldd
% references controllerCoreAlgorithmData.sldd
% references commonData.sldd

DEFAULT_CLIENT_DEVICE_ID_LIST = Simulink.Parameter([struct(device_id=uint8(repmat(0, 10, 1))), struct(device_id=uint8(repmat(0, 10, 1))), struct(device_id=uint8(repmat(0, 10, 1))), struct(device_id=uint8(repmat(0, 10, 1)))], DataType="struct")