% Simulink data dictionary sensorCoreAlgorithmData.sldd
% references commonData.sldd

SENSOR_SAMPLE_TIME = 0.5
SensorCodeGenerationConfigurationSet = Simulink.ConfigSet(StartTime="0", StopTime="50", Solver="FixedStepDiscrete", ProdHWDeviceType="Intel->x86-64 (Windows64)", SystemTargetFile="ert.tlc", TargetLang="C")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